# Grasshopper definition shp-to-3dm.gh (Grasshopper 1.0.7)
# plug-ins: Bifocals, atit

toggle = BooleanToggle(True)
# 01 ROAD
# 
# A001
path = FilePath("C:\Users\chgem\Desktop\micro\2021\N3A_A0010000_A000_000000.shp")  # disabled
toggle_2 = BooleanToggle(True)
# 02 Terrain - F001
path_2 = FilePath("C:\Users\chgem\Desktop\micro\2021\N3L_F0010000_F001_000000.shp")  # disabled
toggle_3 = BooleanToggle(True)
imp_it = ImpIt(ShapefileShpPath=path, Project2WGS84=False, TrueOrFalse=toggle)  # -> Shapes, Features
# 03 Building - B001
path_3 = FilePath("C:\Users\chgem\Desktop\micro\2021\N3A_B0010000_B001_000000.shp")  # disabled
imp_it_2 = ImpIt(ShapefileShpPath=path_2, Project2WGS84=False, TrueOrFalse=toggle_2)  # -> Shapes, Features
panel = Panel(imp_it.Features)
panel_2 = Panel(imp_it_2.Features)
imp_it_3 = ImpIt(ShapefileShpPath=path_3, Project2WGS84=False, TrueOrFalse=toggle_3)  # -> Shapes, Features
panel_3 = Panel(imp_it_3.Features)
item = ListItem(List=imp_it.Features, Index=Slider(4, range=0..10), Wrap=True)
datavis_it = DataVisIt(Shapes=imp_it.Shapes, GetValueofFeature=item, TrueOrFalse=toggle)  # -> Polygon, Polyline, Point, AttValues
item_2 = ListItem(List=imp_it_2.Features, Index=Slider(2, range=0..10), Wrap=True)
datavis_it_2 = DataVisIt(Shapes=imp_it_2.Shapes, GetValueofFeature=item_2, TrueOrFalse=toggle_2)  # -> Polygon, Polyline, Point, AttValues
panel_4 = Panel(datavis_it_2.AttValues)
item_3 = ListItem(List=imp_it_3.Features, Index=Slider(7, range=0..10), Wrap=True)
datavis_it_3 = DataVisIt(Shapes=imp_it_3.Shapes, GetValueofFeature=item_3, TrueOrFalse=toggle_3)  # -> Polygon, Polyline, Point, AttValues
Z = UnitZ(Factor=1)
panel_5 = Panel(datavis_it.Polygon)
multiplication = Multiplication(A=datavis_it_2.AttValues, B=Z)
crv = Curve(datavis_it.Polygon)
crv_2 = Curve(datavis_it_2.Polyline)
move = Move(Geometry=crv_2, Motion=multiplication)  # -> flatten(Geometry), Transform
crv_3 = Curve(datavis_it_3.Polygon)
runion = RegionUnion(Curves=flatten(crv))
flatten = FlattenTree(Tree=datavis_it_3.AttValues, Path="{0}")
boundary = BoundarySurfaces(Edges=crv_3)
item_4 = ListItem(List=boundary, Index=0, Wrap=True)  # -> flatten(Item)
divlength = DivideLength(Curve=move.Geometry, Length=Slider(9, range=0..100))  # -> flatten(Points), Tangents, Parameters
bbox = BoundingBox(Content=move.Geometry, Plane=PlaneXY(0, 0, 0), UnionBox=True)  # -> Box, Box_2
area = Area(Geometry=item_4)  # -> Area, Centroid
Z_2 = UnitZ(Factor=1)
srf = Surface(<surface referenced from the Rhino model>)
box = EvaluateBox(Box=bbox.Box, UParameter=0.5, VParameter=0.5, WParameter=0.5)  # -> Plane, Point, Include
Z_3 = UnitZ(Factor=Slider(59, range=0..1000))
sec = BrepPlane(Brep=bbox.Box, Plane=box.Plane)  # -> Curves, Points
project = ProjectPoint(Point=area.Centroid, Direction=Z_2, Geometry=srf)  # -> Point, Index
neg = Negative(Value=Z_3)
vec2pt = Vector2Pt(PointA=area.Centroid, PointB=project.Point, Unitize=False)  # -> Vector, Length
disc = Discontinuity(Curve=sec.Curves, Level=1)  # -> Points, Parameters
move_2 = Move(Geometry=sec.Curves, Motion=neg)  # -> Geometry, Transform
cp = ClosestPoint(Point=disc.Points, Cloud=divlength.Points)  # -> ClosestPoint, CPIndex, Distance
null = NullItem(Item=vec2pt.Vector)  # -> NullFlags, InvalidFlags, Description
neg_2 = Negative(Value=Slider(3, range=0..10))
panel_6 = Panel(disc.Points)
cull = CullPattern(List=item_4, CullPattern=invert(null.NullFlags))
xy = XYPlane(Origin=cp.ClosestPoint)
cull_2 = CullPattern(List=flatten, CullPattern=invert(null.NullFlags))
cull_3 = CullPattern(List=vec2pt.Vector, CullPattern=invert(null.NullFlags))
offset = OffsetCurve(Curve=move_2.Geometry, Distance=neg_2, Corners=1)
project_2 = Project(Geometry=disc.Points, Plane=xy)  # -> Geometry, Transform
del = DelaunayMesh(Points=flatten([divlength.Points, project_2.Geometry]), Plane=PlaneXY(0, 0, 0))
viewer = ParamViewer(cull)
viewer_2 = ParamViewer(cull_2)
viewer_3 = ParamViewer(cull_3)
srf_2 = Surface(offset)
number_slider = Slider(20, range=0..100)
multiplication_2 = Multiplication(A=cull_2, B=Slider(3, range=0..10))
move_3 = Move(Geometry=cull, Motion=cull_3)  # -> Geometry, Transform
sdivide = DivideSurface(Surface=srf_2, UCount=number_slider, VCount=Slider(20, range=0..100))  # -> Points, Normals, Parameters
Z_4 = UnitZ(Factor=1)
Z_5 = UnitZ(Factor=multiplication_2)
extr = Extrude(Base=move_3.Geometry, Direction=Z_5)
meshray = MeshRay(Mesh=del, Point=sdivide.Points, Direction=Z_4)  # -> Point, Hit
panel_7 = Panel(meshray.Point)
srfgrid = SurfaceFromPoints(Points=flatten(meshray.Point), UCount=expr("x+1", number_slider), Interpolate=False)
